# Grasshopper definition nameplate_definition_v2.gh (Grasshopper 1.0.7)

# ---- group: RH_IN:path
txt = Text("C:\Dummy\JWLN0300.dxf")

# ----
panel = Panel(txt)

_3dm = Import3DM(File=panel, Layer="*", Name="*")
crv = Curve(_3dm)

list = ValueList({"Yellow Gold": 0, "Rose Gold": 1, "White Gold": 2, "Silver": 3}, selected="Silver")
pt = Point(Point(0, 0, 0))

runion = RegionUnion(Curves=crv)
area = Area(Geometry=runion)  # -> Area, Centroid
pt_2 = Point(area.Centroid)
ln = Line(StartPoint=pt_2, EndPoint=pt)
move = Move(Geometry=crv, Motion=ln)  # -> flatten(Geometry), Transform

# ---- group: RH_IN:number
int = Integer(list)

# ----
srf = Surface(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)
srfsplit = SurfaceSplit(Surface=srf, Curves=move.Geometry)
amoments = AreaMoments(Geometry=srfsplit)  # -> Area, Centroid, Inertia, InertiaError, Secondary, SecondaryError, Gyration
number_slider = Slider(0.1, range=0..1)
cp = ClosestPoint(Point=pt, Cloud=amoments.Centroid)  # -> ClosestPoint, CPIndex, Distance
item = ListItem(List=srfsplit, Index=cp.CPIndex, Wrap=True)
num = Number(0.08751)
scale_nu = ScaleNU(Geometry=item, Plane=PlaneXY(0, 0, 0), ScaleX=number_slider, ScaleY=number_slider, ScaleZ=1)  # -> Geometry, Transform
num_2 = Number(0.12)
filter = StreamFilter(Gate=int, Stream0=num, Stream1=num, Stream2=num, Stream3=num_2)
Z = UnitZ(Factor=filter)
extr = Extrude(Base=scale_nu.Geometry, Direction=Z)
mesh = MeshBrep(
    Brep=extr,
    Settings={GridMaxCount=0, GridMinCount=16, JaggedSeams=False, MaxEdgeLength=0, MinEdgeLength=0.0001, MinTolerance=0, Refine=True, RefineAngle=0, RelativeTolerance=0.65, SimplePlanes=True, Tolerance=0})

# ---- group: RH_OUT:mesh
mesh_2 = Mesh(mesh)
